# Grasshopper definition brimstone_0.1.3a.gh (Grasshopper 1.0.7)
# plug-ins: Human

fly = Brimstone0Fly()
# ---------- fly: Python ----------
"""This component sets up global information for Brimstone
    Inputs:
    Output:
        """

import scriptcontext

scriptcontext.sticky["brimstone_version"] = '0.1.3'
scriptcontext.sticky["brimstone_flying"] = 'true'
ghenv.Component.Message = scriptcontext.sticky["brimstone_version"]
# ---------- end fly ----------
list = ValueList({"Swedish": "sv", "English": "en"}, selected="English")

# ----
# Get Klimatdatabas data
panel = Panel("./database.json")
list_2 = ValueList({"File": "file", "API": "api"}, selected="API")
get_categories = Brimstone1GetCategories(mode=list_2, language=list, json_path=panel)  # -> out, json_data, categories, klimatdatabas_version
# ---------- get_categories: Python ----------
"""Gets Klimatdatabas from the Boverket API or a file, extracts json data, and resource category names
    Inputs:
        mode: api or file mode
        language: language of database to retrieve
        json_path: path to json file if file mode
    Output:
        json_data: json file as dictionary
        categories: Categories present in the database
        klimatdatabas_version: String representing the version of Klimatdatabas used"""

import scriptcontext

ghenv.Component.Name = 'Brimstone - 1. Get Categories'
ghenv.Component.NickName = 'Get Categories'
ver = scriptcontext.sticky["brimstone_version"]
ghenv.Component.Message = ver

import json

from System.Net import WebRequest
from System.IO import StreamReader
from System.Text import Encoding

def main(mode, json_path):    
    if mode == "file":
        json_data = get_json_data_from_file(json_path)
    elif mode == "api":
        json_data = get_json_data_from_api()
    else:
        raise Exception("Mode {mode} not supported".format(mode = mode))
    
    categories = get_categories(json_data)
    version = json_data.get("Version") 
    
    return categories, json_data, version

def get_json_data_from_file(json_path):
    f = open(json_path)
    json_data = json.load(f)
    return json_data
    
def get_json_data_from_api():
    version = "02.04.000"
    lng = language if language else "en"
    format = "json"

    url = "https://api.boverket.se/klimatdatabas/get-all-resources/{version}/{language}/{format}".format(
        version=version, language=lng, format=format)
    
    request = WebRequest.Create(url)
    
    request.Method = "GET"
    request.Timeout = 5000
    #request.ContentType = "application/json"
    response = request.GetResponse()
    
    stream_reader = StreamReader(response.GetResponseStream())
    json_data = json.loads(stream_reader.ReadToEnd())
    return json_data
    
def get_categories(json_data):
    categories = []
    try:
        for metaCategory in json_data['Categories']:
            for cat in metaCategory["Children"]:
                categories.append(cat["Title"])
    except KeyError:
        raise Exception("Format of JSON data is not supported.")
    return categories

if __name__ == "__main__":
    if not scriptcontext.sticky["brimstone_flying"]:
        raise Exception("The 'Brimstone - Fly' component needs to exist on the canvas")
    categories, json_data, klimatdatabas_version = main(mode, json_path)
    json_data = [json_data] # need to put it in an array so GH understands it as a dictionary
# ---------- end get_categories ----------

panel_2 = Panel(get_categories.klimatdatabas_version)
# Select category
list_3 = ItemSelector(
    get_categories.categories,
    {"Building boards", "Insulation", "Solid woods", "Concrete", "Blocks and tiles", "Mineral materials", "Windows, doors and glass", "Waterproofing", "Paints and sealants", "Steel and other metals", "Energy and fuel"}, selected="Blocks and tiles")
get_resources = Brimstone2GetResources(json_data=get_categories.json_data, category=list_3)  # -> out, json_data, resources
# ---------- get_resources: Python ----------
"""Extracts resource names from a Klimatdatabas json object
    Inputs:
        json_data: dictionary with json data
        category: readable name of category to extract resources from
    Output:
        resources: List of resources in category"""

import scriptcontext

ghenv.Component.Message = scriptcontext.sticky["brimstone_version"]

def main(json_data, category):
    resources = get_resources(json_data, category)
    return resources
    
def get_resources(json_data, category):
    pred = lambda v: v["Text"] == category
    resources = []
    for resource in json_data["Resources"]:
        #print resource["Categories"]
        if len(filter(pred, resource["Categories"])) > 0:
            resources.append(resource["Name"])
    return resources

if __name__ == "__main__":
    if not scriptcontext.sticky["brimstone_flying"]:
        raise Exception("The 'Brimstone - Fly' component needs to exist on the canvas")
    resources = main(json_data, category)
    json_data = [json_data]
# ---------- end get_resources ----------

# ----
# Select resource(s)
list_4 = ItemSelector(
    get_resources.resources,
    {"Concrete roof tiles", "Concrete roof tiles, climate-improved", "Clay roof tiles", "Bricks", "Bricks, hardburned", "Sand lime bricks", "Expanded clay concrete block, <10 % cement (650-700 kg/m³)", "Expanded clay concrete block, 10-14 % cement (700-770 kg/m³)", "Expanded clay concrete block, 15-17 % cement (700-770 kg/m³)", "Expanded clay concrete block, 18-24 % cement (700-800 kg/m³)", "Lightweight expanded clay clinker", "Autoclaved Aerated Concrete, (AAC)", "Autoclaved Aerated Concrete (AAC), reinforced element", "Bricks, second firing", "Reused construction product", "Bricks beam", "Brick beam, second firing", "Wind barrier for facades, spun polyethylene & polypropylene", "Photovoltaic cells, mono-Si", "Photovoltaic cells, multi-Si", "Photovoltaic cells, CI(G)S", "Photovoltaic cells, CdTe", "Photovoltaic cells, OPV", "Plastic products type thermoplastic polyolefins, unspecified", "Synthetic rubber type EPDM and SBR, unspecified", "Synthetic rubber type neoprene and butadiene, unspecified", "Slate plates incl steel ribs"}, selected="Expanded clay concrete block, 10-14 % cement (700-770 kg/m³)")
list_5 = ItemSelector(
    get_resources.resources,
    {"Concrete roof tiles", "Concrete roof tiles, climate-improved", "Clay roof tiles", "Bricks", "Bricks, hardburned", "Sand lime bricks", "Expanded clay concrete block, <10 % cement (650-700 kg/m³)", "Expanded clay concrete block, 10-14 % cement (700-770 kg/m³)", "Expanded clay concrete block, 15-17 % cement (700-770 kg/m³)", "Expanded clay concrete block, 18-24 % cement (700-800 kg/m³)", "Lightweight expanded clay clinker", "Autoclaved Aerated Concrete, (AAC)", "Autoclaved Aerated Concrete (AAC), reinforced element", "Bricks, second firing", "Reused construction product", "Bricks beam", "Brick beam, second firing", "Wind barrier for facades, spun polyethylene & polypropylene", "Photovoltaic cells, mono-Si", "Photovoltaic cells, multi-Si", "Photovoltaic cells, CI(G)S", "Photovoltaic cells, CdTe", "Photovoltaic cells, OPV", "Plastic products type thermoplastic polyolefins, unspecified", "Synthetic rubber type EPDM and SBR, unspecified", "Synthetic rubber type neoprene and butadiene, unspecified", "Slate plates incl steel ribs"}, selected="Concrete roof tiles")
panel_3 = Panel("""RefServiceLifeNormal
WasteFactor
TechnologyDescriptionAndIncludedProcesses""")
get_lca_data = Brimstone3GetLCAData(json_data=get_resources.json_data, resources=list_4, addtl_indicators=panel_3)  # -> out, json_data, lca_data, indicators, values; inputs resources: list, addtl_indicators: list
#   port json_data: List of resources in category
# ---------- get_lca_data: Python ----------
"""Extracts LCA indicators and values from a Klimatdatabas json for a specific resource
    Inputs:
        json_data: dictionary with json data
        resources: list of readable names of resources
        addtl_indicators: list of additional keys to retrieve from resource
    Output:
        lca_data: list of dictionaries with LCA data for each resource
        indicators: list of indicators
        values: list of indicator values"""

import scriptcontext

import ghpythonlib.treehelpers as th

from collections import OrderedDict

ghenv.Component.Message = scriptcontext.sticky["brimstone_version"]

import copy

# todo: magic string here - not good!
gwp_data_string = "Global Warming potential"

# keys: names in output dict, values: DataModuleCode in json db
gwp_data_entries = {
    "GWPA1A3Conservative": "A1-A3 Conservative",
    "GWPA1A3Typical": "A1-A3 Typical",
    "GWPA4": "A4",
    "GWPA5.1": "A5.1",
}

def main(json_data, resource, addtl_indicators):
    lca_data, indicators, values = [], [], []

    for i, resource in enumerate(resources):
        lca_data.append(get_lca_data(json_data, resource, addtl_indicators))
        resource_indicators, resource_values = get_indicator_values(lca_data[i], addtl_indicators)
        indicators.append(resource_indicators)
        values.append(resource_values)
    return lca_data, indicators, values
    
def get_lca_data(json_data, resource_name, addtl_indicators):
    resource_data = copy.deepcopy(
        find_obj_in_array(
            json_data["Resources"],
            "Name",
            resource_name
        )
    )
    
    if not resource_data:
        raise Exception(
            "Resource with name {resource_name} was not found in database."
            .format(resource_name = resource_name)
       )
    try:
        lca_data = extract_lca_data(resource_data, addtl_indicators)
    except KeyError:
        raise Exception("Format of JSON data is not supported.")
    return lca_data

def extract_lca_data(resource_data, addtl_indicators):
    lca_data = OrderedDict()
    resource_name = resource_data["Name"]
    
    lca_data["Name"] = resource_name
    
    if "Conversions" in resource_data:
        # can a resource have multiple conversions?
        lca_data["ConversionUnit"] = resource_data["Conversions"][0]["Unit"]
        lca_data["ConversionValue"] = resource_data["Conversions"][0]["Value"]
    
    if "InventoryUnit" in resource_data:
        lca_data["InventoryUnit"] = resource_data["InventoryUnit"]
    
    for data_prop in resource_data["DataItems"]:
        if data_prop["PropertyName"] == gwp_data_string:
            gwp_data = copy.deepcopy(data_prop)
            break
            
    if not gwp_data:
        raise Exception("GWP data not found for {resource_name}"
            .format(resource_name = resource_name))
    
    lca_data["GWPUnit"] = gwp_data["PropertyUnitCode"]
    for key in gwp_data_entries:
        value = find_obj_in_array(
            gwp_data["DataValueItems"],
            "DataModuleCode",
            gwp_data_entries[key]
        )
        if value is not None:
            lca_data[key] = value["Value"]
            
    for addtl_indicator in addtl_indicators:
        if addtl_indicator in resource_data:
            lca_data[addtl_indicator] = resource_data[addtl_indicator]
    
    return lca_data

def find_obj_in_array(array, key, value):
    return next((x for x in array if x[key] == value), None)

def get_indicator_values(lca_data, addtl_indicators):
    indicator_dict = OrderedDict([
        ("Name", "Name"),
        ("InventoryUnit", "Inventory unit"),
        ("ConversionUnit", "Conversion unit"),
        ("ConversionValue", "Conversion value"),
        ("GWPUnit", "GWP unit"),
        ("GWPA1A3Conservative", "GWP (A1-A3 Conservative)"),
        ("GWPA1A3Typical", "GWP (A1-A3 Typical)"),
        ("GWPA4", "GWP (A4)"),
        ("GWPA5.1", "GWP (A5.1)"),
    ])
    
    for addtl_indicator in addtl_indicators:
        indicator_dict[addtl_indicator] = addtl_indicator
    
    indicators, values = [], []
    
    for key, indicator_name in indicator_dict.items():
        indicator_value = lca_data[key] if key in lca_data else None
        if indicator_value:
            indicators.append(indicator_name)
            values.append(indicator_value)
    
    return indicators, values

if __name__ == "__main__":
    if not scriptcontext.sticky["brimstone_flying"]:
        raise Exception("The 'Brimstone - Fly' component needs to exist on the canvas")
    lca_data, indicators, values = main(json_data, resources, addtl_indicators)
    
    lca_data_treeable = []
    
    for resource_lca_data in lca_data:
        lca_data_treeable.append([resource_lca_data.keys(), resource_lca_data.values()])
    lca_data = th.list_to_tree(lca_data_treeable)
    indicators = th.list_to_tree(indicators)
    values = th.list_to_tree(values)
    json_data = [json_data]
# ---------- end get_lca_data ----------

# ----
# Extract LCA data
concat = Concatenate(FragmentA=get_lca_data.indicators, FragmentC=": ", FragmentB=get_lca_data.values)
panel_4 = Panel(concat)

list_6 = ValueList({"Conservative": "conservative", "Typical": "typical"}, selected="Conservative")

pt = Point(Point(1, 1, 1))
# Connect GWP data to geometry
pt_2 = Point(Point(0, 0, 0))
box = Box2Pt(PointA=pt_2, PointB=pt, Plane=PlaneXY(0, 0, 0))
calculate_solid_geometry = Brimstone4CalculateSolidGeometry(lca_data=get_lca_data.lca_data, geometry=box, mode=list_6)  # -> out, gwp_total; inputs lca_data: tree, geometry: GeometryBase
# ---------- calculate_solid_geometry: Python ----------
"""Extracts LCA indicators and values from a Klimatdatabas json for a specific resource
    Inputs:
        lca_data: 
        geometry: brep geometry
        addtl_indicators: list of additional keys to retrieve from resource
    Output:
        lca_data: list of dictionaries with LCA data for each resource
        indicators: list of indicators
        values: list of indicator values"""

import scriptcontext
ghenv.Component.Message = scriptcontext.sticky["brimstone_version"]
from Grasshopper.Kernel import GH_RuntimeMessageLevel as Message

import rhinoscriptsyntax as rs
import ghpythonlib.treehelpers as th

from collections import OrderedDict

mass_inv_unit_string = 'kg' # mass
density_conv_unit_string = u'kg/m\xb3' # density
gwp_unit_string = 'kg CO2 eq./kg' # GWP

def main(lca_data, geometry, mode):
    if not lca_data.BranchCount:
        ghenv.Component.AddRuntimeMessage(Message.Warning, "LCA data is missing")
        return
    if not geometry:
        ghenv.Component.AddRuntimeMessage(Message.Warning, "Geometry is missing")
        return
    lca_data = th.tree_to_list(lca_data)
    lca_data = [OrderedDict(zip(l[0], l[1])) for l in lca_data]
    gwp_total =  []
    
    for resource_lca_data in lca_data:
        try:
            gwp_total.append(calculate_gwp_total(resource_lca_data, geometry, mode))
        except KeyError as e:
            raise Exception("GWP value could not be calculated: {error}".format(error = e))
    
    
    return gwp_total
    
def calculate_gwp_total(lca_data, geometry, mode):    
    inv_unit = lca_data["InventoryUnit"]
    conv_unit = lca_data["ConversionUnit"]
    
    if conv_unit != density_conv_unit_string or inv_unit != mass_inv_unit_string:
        raise Exception("Wrong unit for conversion from volume to mass")    
    
    gwp_unit = lca_data["GWPUnit"]
    if gwp_unit != gwp_unit_string:
        raise Exception("Wrong unit for GWP calculation")
    
    vol = rs.SurfaceVolume(geometry)[0]
    conv_value = lca_data["ConversionValue"]
    
    if mode == "conservative":
        gwp_a1_a3_str = "GWPA1A3Conservative"
    elif mode == "typical":
        gwp_a1_a3_str = "GWPA1A3Typical"
    else:
        raise Exception("Mode not recognised (must be conservative or typical)")
    
    gwp_total = (
        lca_data[gwp_a1_a3_str]
        + lca_data["GWPA4"] \
        + lca_data["GWPA5.1"]
    ) * vol * conv_value
        
    return gwp_total

if __name__ == "__main__":
    if not scriptcontext.sticky["brimstone_flying"]:
        raise Exception("The 'Brimstone - Fly' component needs to exist on the canvas")   
    gwp_total = main(lca_data, geometry, mode)
    gwp_total = th.list_to_tree(gwp_total)
# ---------- end calculate_solid_geometry ----------
panel_5 = Panel(calculate_solid_geometry.gwp_total)

item = ListItem(List=get_lca_data.values, Index=0, Wrap=True)
panel_6 = Panel(item)
