# Grasshopper definition brimstone_0.1.8.ghx (Grasshopper 1.0.8)
# plug-ins: Human

# Get Klimatdatabas data
fly = BrimstoneFly()
# ---------- fly: Python ----------
"""This component sets up global information for Brimstone
    Inputs:
    Output:
        """

import Grasshopper
import sys, os
root = Grasshopper.Folders.UserObjectFolders[0]

# Allow both root and /Brimstone subfolder
candidates = [
    root,
    os.path.join(root, "Brimstone"),
    os.path.join(root, "brimstone")
]

for path in candidates:
    if os.path.isdir(path) and path not in sys.path:
        sys.path.append(path)
        

import brimstone
reload(brimstone)

import scriptcontext

ghenv.Component.Name = 'Brimstone - Fly!'
ghenv.Component.NickName = 'Fly!'

scriptcontext.sticky["brimstone_flying"] = 'true'
ghenv.Component.Message = brimstone.globals.version
# ---------- end fly ----------

list = ValueList({"Swedish": "sv", "English": "en"}, selected="English")
list_2 = ValueList({"File": "file", "API": "api"}, selected="API")
get_categories = BrimstoneGetCategories(mode=list_2, language=list)  # -> out, json_data, categories, klimatdatabas_version
# ---------- get_categories: Python ----------
"""Gets Klimatdatabas from the Boverket API or a file, extracts json data, and resource category names
    Inputs:
        mode: api or file mode
        language: language of database to retrieve
        json_path: path to json file if file mode
    Output:
        json_data: json file as dictionary
        categories: Categories present in the database
        klimatdatabas_version: String representing the version of Klimatdatabas used"""

import scriptcontext
import brimstone
import Grasshopper
import os, io

ghenv.Component.Name = 'Brimstone - Get Categories'
ghenv.Component.NickName = 'Get Categories'
ver = brimstone.globals.version
ghenv.Component.Message = ver

import json

from System.Net import WebRequest
from System.IO import StreamReader
from System.Text import Encoding

def main(mode):    
    if mode == "file":
        json_file = brimstone.globals.kdb_json_path
        json_path = os.path.join(Grasshopper.Folders.UserObjectFolders[0], json_file)
        if not os.path.exists(json_path):
            raise Exception("Failed to open json file, it should reside in [UserComponents folder]/brimstone_data/")
        json_data = get_json_data_from_file(json_path)
    elif mode == "api":
        json_data = get_json_data_from_api()
    else:
        raise Exception("Mode {mode} not supported".format(mode = mode))
    
    categories = get_categories(json_data)
    version = json_data.get("Version") 
    
    return categories, json_data, version

def get_json_data_from_file(json_path):
    f = io.open(json_path, encoding='utf-8')
    json_data = json.load(f)
    return json_data
    
def get_json_data_from_api():
    version = "02.06.000"
    lng = language if language else "en"
    format = "json"

    url = "https://api.boverket.se/klimatdatabas/api/Klimat/v2/GetAllResources/{version}/{language}/{format}".format(
        version=version, language=lng, format=format)
    
    request = WebRequest.Create(url)
    
    request.Method = "GET"
    request.Timeout = 5000
    #request.ContentType = "application/json"
    response = request.GetResponse()
    
    stream_reader = StreamReader(response.GetResponseStream())
    json_data = json.loads(stream_reader.ReadToEnd())
    return json_data
    
def get_categories(json_data):
    categories = []
    try:
        for metaCategory in json_data['Categories']:
            for cat in metaCategory["Children"]:
                categories.append(cat["Title"])
    except KeyError:
        raise Exception("Format of JSON data is not supported.")
    return categories

if __name__ == "__main__":
    if not scriptcontext.sticky["brimstone_flying"]:
        raise Exception("The 'Brimstone - Fly' component needs to exist on the canvas")
    categories, json_data, klimatdatabas_version = main(mode)
    json_data = [json_data] # need to put it in an array so GH understands it as a dictionary
# ---------- end get_categories ----------
panel = Panel(get_categories.klimatdatabas_version)

panel_2 = Panel("This is a fictive material meant to demonstrate the Brimstone component \"create resource\".")
merge = Merge(Data1=Slider(1.25, range=0..10), Data2="Material A")
merge_2 = Merge(Data1="WasteFactor", Data2="Synonyms")
number_slider = Slider(0.3, range=0..1)
list_3 = ItemSelector(
    get_categories.categories,
    {"Mineral materials", "Windows, doors and glass", "Paints and sealants", "Concrete", "Insulation", "Steel and other metals", "Blocks and tiles", "Building boards", "Waterproofing", "Solid woods", "Energy and fuel"}, selected="Mineral materials")
entwine = Entwine(Branch00=merge_2, Branch01=merge, FlattenInputs=True)  # -> simplify(Result)
# Add custom material to database
panel_3 = Panel("My material")
create_klimatdatabas_resource = BrimstoneCreateKlimatdatabasResource(
    name=panel_3,
    category=list_3,
    general_comment=panel_2,
    inventory_unit="kg",
    volume_conversion=Slider(100, range=0..100),
    gwp_a1_a3_conservative=number_slider,
    gwp_a1_a3_typical=number_slider,
    gwp_a4=Slider(0.4, range=0..1),
    gwp_a5_1=Slider(0.3, range=0..1),
    addtl_data=entwine)  # -> out, resource; inputs addtl_data: tree
# ---------- create_klimatdatabas_resource: Python ----------
"""Cretes a resource which can be added to a Klimatdatabas json object
    Inputs:
        name: string representing the name of the resource
        category: string representing the Klimatdatabas category of the resource
        general_comment: string representing a comment for the resource
        inventory_unit: unit used for the inventory, if unset defaults to "kg"
        volume_conversion: density of the material in kg/m3
        gwp_a1_a3_conservative: global warming potential, module A1-A3 (conservative value)
        gwp_a1_a3_typical: global warming potential, module A1-A3 (typical value)
        gwp_a4: global warming potential, module A4
        gwp_a5_1: global warming potential, module A5.1
        addtl_data: tree with two branches, the first a list of strings representing data points to add, the secondly with the corresponding values to add/replace
    Output:
        resource: dictionary representing resource"""

import scriptcontext
import ghpythonlib.treehelpers as th
import brimstone
from datetime import datetime
reload(brimstone)

ghenv.Component.Message = brimstone.globals.version
ghenv.Component.Name = 'Brimstone - Create Klimatdatabas resource'
ghenv.Component.NickName = 'Create Klimatdatabas resource'

def main(data, addtl_data):
    resource =  {        
        "ResourceId": 6000000000,
        "SourceVersion": "",
        "ProductSystemId": -1,
        "ProductSystemResourceId": "",
        "Location": "SE",
        "Publisher": "Boverket, Sweden",
        "Version": "",
        "Copyright": False,
        "TimeStamp": datetime.now().isoformat(),
        "Name": data["name"],
        "Names": {
          "EN": data["name"],
          "SV": data["name"]
        },
        "StdName": "",
        "StdDescription": "",
        "StdCalc": "",
        "UseAdviceForDataSet": "",
        "TechnologicalApplicability": "",
        "GeneralComment": data["general_comment"],
        "Synonyms": "",
        "TechnologyDescriptionAndIncludedProcesses": "",
        "GeographicalRepresentativenessDescription": "",
        "TimeRepresentativenessDescription": "",
        "UpdatedTime": datetime.now().isoformat(),
        "InventoryUnit": data["inventory_unit"],
        "CalculatedBiogenicCarbon": None,
        "ConservativeDataConversionFactor": None,
        "WasteFactor": None,
        "RefServiceLifeNormal": "",
        "RefServiceLifeNormalComment": "",
        "ComparativeProperty": "",
        "A4ValueBackground": "",
        "AnnualSupplyOrProductionVolume": "",
        "Conversions": [{
          "Field": "Volume",
          "Unit": "kg/m³",
          "Value": data["volume_conversion"]
        }],
        "DataItems": [{
          "PropertyId": 1845,
          "PropertyName": "Global Warming potential",
          "PropertyCode": "GWP-GHG AR4",
          "PropertyTypeId": 2,
          "PropertyUnitCode": "kg CO2 eq./kg",
          "DataValueItems": [{
            "DataModuleCode": "A1-A3 Conservative",
            "Value": data["gwp_a1_a3_conservative"]
          }, {
            "DataModuleCode": "A1-A3 Typical",
            "Value": data["gwp_a1_a3_typical"]
          }, {
            "DataModuleCode": "A4",
            "Value": data["gwp_a4"]
          }, {
            "DataModuleCode": "A5.1",
            "Value": data["gwp_a5_1"]
          }]
        }],
        "Categories": [{
          "ClassificationType": "Boverket",
          "Text": data["category"]
        }]
    }
    
    if addtl_data.BranchCount:
        addtl_data_list = th.tree_to_list(addtl_data, None)
        print addtl_data_list
        data_keys = addtl_data_list[0]
        data_vals = addtl_data_list[1]
        if not len(data_keys) == len(data_vals):
            brimstone.utils.warn(ghenv, "The number if additional data keys and data values must be the same")
        elif not len(data_keys) == len(set(data_keys)):
            brimstone.utils.warn(ghenv, "The additional data keys must be unique")
        else:
            for i, key in enumerate(data_keys):
                resource[str(key)] = str(data_vals[i])
    
    print resource
    return resource

if __name__ == "__main__":
    if not scriptcontext.sticky["brimstone_flying"]:
        raise Exception("The 'Brimstone - Fly' component needs to exist on the canvas")
    
    replace_null = brimstone.utils().replace_null
    
    data = {
        "name": replace_null(name, ""),
        "category": replace_null(category, ""),
        "general_comment": replace_null(general_comment, ""),
        "inventory_unit": replace_null(inventory_unit, "kg"),
        "volume_conversion": replace_null(volume_conversion, 0),
        "gwp_a1_a3_conservative": replace_null(gwp_a1_a3_conservative, 0),
        "gwp_a1_a3_typical": replace_null(gwp_a1_a3_typical, 0),
        "gwp_a4": replace_null(gwp_a4, 0),
        "gwp_a5_1": replace_null(gwp_a5_1, 0),
    }
    
    resource = main(data, addtl_data)
    resource = [resource]
# ---------- end create_klimatdatabas_resource ----------
add_resource_to_klimatdatabas = BrimstoneAddResourceToKlimatdatabasData(json_data=get_categories.json_data, resource=create_klimatdatabas_resource.resource)  # -> out, json_data
# ---------- add_resource_to_klimatdatabas: Python ----------
"""Adds a resource to a Klimatdatabas json object
    Inputs:
        json_data: dictionary with json data
        resource: dictionary representing the resource data
    Output:
        json_data: updated dictionary with json data"""

import scriptcontext
import brimstone
ghenv.Component.Message = brimstone.globals.version
import copy

ghenv.Component.Name = 'Brimstone - Add resource to Klimatdatabas data'
ghenv.Component.NickName = 'Add resource to Klimatdatabas'

def main(json_data, resource):
    print resource
    resource_cat = resource["Categories"][0]["Text"]
    pred = lambda v: v["Title"] == resource_cat
    if not filter(pred, json_data["Categories"][0]["Children"]):
        raise Exception("Could not add resource to database as the indicated category does not exist in the database.")
    json_data["Resources"].append(resource)
    return json_data

if __name__ == "__main__":
    if not scriptcontext.sticky["brimstone_flying"]:
        raise Exception("The 'Brimstone - Fly' component needs to exist on the canvas")
    json_data = main(copy.deepcopy(json_data), resource)
    json_data = [json_data]
# ---------- end add_resource_to_klimatdatabas ----------

list_4 = ItemSelector(
    get_categories.categories,
    {"Mineral materials", "Windows, doors and glass", "Paints and sealants", "Concrete", "Insulation", "Steel and other metals", "Blocks and tiles", "Building boards", "Waterproofing", "Solid woods", "Energy and fuel"}, selected="Mineral materials")

# ----
# Select category
list_5 = ItemSelector(
    get_categories.categories,
    {"Mineral materials", "Windows, doors and glass", "Paints and sealants", "Concrete", "Insulation", "Steel and other metals", "Blocks and tiles", "Building boards", "Waterproofing", "Solid woods", "Energy and fuel"}, selected="Mineral materials")
get_resources = BrimstoneGetResources(json_data=add_resource_to_klimatdatabas.json_data, category=list_5)  # -> out, json_data, resources
# ---------- get_resources: Python ----------
"""Extracts resource names from a Klimatdatabas json object
    Inputs:
        json_data: dictionary with json data
        category: readable name of category to extract resources from
    Output:
        resources: List of resources in category"""

import scriptcontext

import brimstone
ghenv.Component.Message = brimstone.globals.version

ghenv.Component.Name = 'Brimstone - Get Resources'
ghenv.Component.NickName = 'Get Resources'

def main(json_data, category):
    resources = get_resources(json_data, category)
    return resources
    
def get_resources(json_data, category):
    pred = lambda v: v["Text"] == category
    resources = []
    for resource in json_data["Resources"]:
        if len(filter(pred, resource["Categories"])) > 0:
            resources.append(resource["Name"])
    return resources

if __name__ == "__main__":
    if not scriptcontext.sticky["brimstone_flying"]:
        raise Exception("The 'Brimstone - Fly' component needs to exist on the canvas")
    resources = main(json_data, category)
    
    json_data = [json_data]
# ---------- end get_resources ----------

get_resources_2 = BrimstoneGetResources(json_data=get_categories.json_data, category=list_4)  # -> out, json_data, resources
# ---------- get_resources_2: Python ----------
"""Extracts resource names from a Klimatdatabas json object
    Inputs:
        json_data: dictionary with json data
        category: readable name of category to extract resources from
    Output:
        resources: List of resources in category"""

import scriptcontext

import brimstone
ghenv.Component.Message = brimstone.globals.version

ghenv.Component.Name = 'Brimstone - Get Resources'
ghenv.Component.NickName = 'Get Resources'

def main(json_data, category):
    resources = get_resources(json_data, category)
    return resources
    
def get_resources(json_data, category):
    pred = lambda v: v["Text"] == category
    resources = []
    for resource in json_data["Resources"]:
        if len(filter(pred, resource["Categories"])) > 0:
            resources.append(resource["Name"])
    return resources

if __name__ == "__main__":
    if not scriptcontext.sticky["brimstone_flying"]:
        raise Exception("The 'Brimstone - Fly' component needs to exist on the canvas")
    print json_data
    resources = main(json_data, category)
    
    json_data = [json_data]
# ---------- end get_resources_2 ----------
list_6 = ItemSelector(
    get_resources_2.resources,
    {"Cement mortar, type A (CS IV)", "Masonry mortar and plastering type B (CS III)", "Plastering and masonry mortar type C (CS II)", "Plastering type C (CS II)", "Plastering type D (CS I)", "Plastering type B (CS III), fibre reinforced 2-layer treatme", "Floor screeds < 17 % cement", "Reinforced floor screeds, < 22 % cement and < 4 % fibres", "Floor screeds, <30 % cement", "Reinforced floor screeds, < 22 % cement", "Rapid floor screeds, <60 % cement", "Reused construction product", "Cement, type CEM II/A-LL 42,5 R", "Dry fine concrete, C32/40", "Dry coarse concrete, C28/35", "Ready-mix made filling mortar (for hollow core deck etc)", "Rapid drying concrete, exposure class XC1"}, selected="Cement mortar, type A (CS IV)")
panel_4 = Panel("Window, wood/aluminium, fixed, 3-glass")
get_resources_3 = BrimstoneGetResources(json_data=add_resource_to_klimatdatabas.json_data, category="Windows, doors and glass")  # -> out, json_data, resources; same code as get_resources

# ----
# Select resource(s)
list_7 = ItemSelector(
    get_resources.resources,
    {"Cement mortar, type A (CS IV)", "Masonry mortar and plastering type B (CS III)", "Plastering and masonry mortar type C (CS II)", "Plastering type C (CS II)", "Plastering type D (CS I)", "Plastering type B (CS III), fibre reinforced 2-layer treatme", "Floor screeds < 17 % cement", "Reinforced floor screeds, < 22 % cement and < 4 % fibres", "Floor screeds, <30 % cement", "Reinforced floor screeds, < 22 % cement", "Rapid floor screeds, <60 % cement", "Reused construction product", "Cement, type CEM II/A-LL 42,5 R", "Dry fine concrete, C32/40", "Dry coarse concrete, C28/35", "Ready-mix made filling mortar (for hollow core deck etc)", "Rapid drying concrete, exposure class XC1", "My material"}, selected="Cement mortar, type A (CS IV)")
panel_5 = Panel("""RefServiceLifeNormal
WasteFactor
TechnologyDescriptionAndIncludedProcesses
ResourceId""")
get_lca_data = BrimstoneGetLCAData(json_data=get_resources.json_data, resources=list_7, addtl_indicators=panel_5)  # -> out, json_data, lca_data, indicators, values; inputs resources: list, addtl_indicators: list
#   port json_data: List of resources in category
# ---------- get_lca_data: Python ----------
"""Extracts LCA indicators and values from a Klimatdatabas json for a specific resource
    Inputs:
        json_data: dictionary with json data
        resources: list of readable names of resources
        addtl_indicators: list of additional keys to retrieve from resource
    Output:
        lca_data: list of dictionaries with LCA data for each resource
        indicators: list of indicators
        values: list of indicator values"""

import scriptcontext
import ghpythonlib.treehelpers as th
from collections import OrderedDict
import copy

import brimstone
ghenv.Component.Message = brimstone.globals.version

ghenv.Component.Name = 'Brimstone - Get LCA Data'
ghenv.Component.NickName = 'Get LCA Data'

# todo: magic string here - not good!
gwp_data_string = "Global Warming potential"

# keys: names in output dict, values: DataModuleCode in json db
gwp_data_entries = {
    "GWPA1A3Conservative": "A1-A3 Conservative",
    "GWPA1A3Typical": "A1-A3 Typical",
    "GWPA4": "A4",
    "GWPA5.1": "A5.1",
}

def main(json_data, resource, addtl_indicators):
    lca_data, indicators, values = [], [], []

    for i, resource in enumerate(resources):
        lca_data.append(get_lca_data(json_data, resource, addtl_indicators))
        resource_indicators, resource_values = get_indicator_values(lca_data[i], addtl_indicators)
        indicators.append(resource_indicators)
        values.append(resource_values)
    return lca_data, indicators, values
    
def get_lca_data(json_data, resource_name, addtl_indicators):
    resource_data = copy.deepcopy(
        find_obj_in_array(
            json_data["Resources"],
            "Name",
            resource_name
        )
    )
    
    if not resource_data:
        raise Exception(
            "Resource with name {resource_name} was not found in database."
            .format(resource_name = resource_name)
       )
    try:
        lca_data = extract_lca_data(resource_data, addtl_indicators)
    except KeyError:
        raise Exception("Format of JSON data is not supported.")
    return lca_data

def extract_lca_data(resource_data, addtl_indicators):
    lca_data = OrderedDict()
    resource_name = resource_data["Name"]
    
    lca_data["Name"] = resource_name
    
    if "Conversions" in resource_data:
        # can a resource have multiple conversions?
        lca_data["ConversionUnit"] = resource_data["Conversions"][0]["Unit"]
        lca_data["ConversionValue"] = resource_data["Conversions"][0]["Value"]
    
    if "InventoryUnit" in resource_data:
        lca_data["InventoryUnit"] = resource_data["InventoryUnit"]
    
    for data_prop in resource_data["DataItems"]:
        if data_prop["PropertyName"] == gwp_data_string:
            gwp_data = copy.deepcopy(data_prop)
            break
            
    if not gwp_data:
        raise Exception("GWP data not found for {resource_name}"
            .format(resource_name = resource_name))
    
    lca_data["GWPUnit"] = gwp_data["PropertyUnitCode"]
    for key in gwp_data_entries:
        value = find_obj_in_array(
            gwp_data["DataValueItems"],
            "DataModuleCode",
            gwp_data_entries[key]
        )
        if value is not None:
            lca_data[key] = value["Value"]
            
    for addtl_indicator in addtl_indicators:
        if addtl_indicator in resource_data:
            lca_data[addtl_indicator] = resource_data[addtl_indicator]
    
    return lca_data

def find_obj_in_array(array, key, value):
    return next((x for x in array if x[key] == value), None)

def get_indicator_values(lca_data, addtl_indicators):
    indicator_dict = OrderedDict([
        ("Name", "Name"),
        ("InventoryUnit", "Inventory unit"),
        ("ConversionUnit", "Conversion unit"),
        ("ConversionValue", "Conversion value"),
        ("GWPUnit", "GWP unit"),
        ("GWPA1A3Conservative", "GWP (A1-A3 Conservative)"),
        ("GWPA1A3Typical", "GWP (A1-A3 Typical)"),
        ("GWPA4", "GWP (A4)"),
        ("GWPA5.1", "GWP (A5.1)"),
    ])
    
    for addtl_indicator in addtl_indicators:
        indicator_dict[addtl_indicator] = addtl_indicator
    
    indicators, values = [], []
    
    for key, indicator_name in indicator_dict.items():
        indicator_value = lca_data[key] if key in lca_data else None
        if indicator_value:
            indicators.append(indicator_name)
            values.append(indicator_value)
    
    return indicators, values

if __name__ == "__main__":
    if not scriptcontext.sticky["brimstone_flying"]:
        raise Exception("The 'Brimstone - Fly' component needs to exist on the canvas")
    lca_data, indicators, values = main(json_data, resources, addtl_indicators)
    
    lca_data_treeable = []
    
    for resource_lca_data in lca_data:
        lca_data_treeable.append([resource_lca_data.keys(), resource_lca_data.values()])
    lca_data = th.list_to_tree(lca_data_treeable)
    indicators = th.list_to_tree(indicators)
    values = th.list_to_tree(values)
    json_data = [json_data]
# ---------- end get_lca_data ----------

get_lca_data_2 = BrimstoneGetLCAData(json_data=get_resources_2.json_data, resources=list_6)  # -> out, json_data, lca_data, indicators, values; inputs resources: list, addtl_indicators: list; same code as get_lca_data
entwine_2 = Entwine(Branch00=list_7, Branch01=panel_4, FlattenInputs=True)
get_lca_data_3 = BrimstoneGetLCAData(json_data=get_resources_3.json_data, resources=panel_4)  # -> out, json_data, lca_data, indicators, values; inputs resources: list, addtl_indicators: list; same code as get_lca_data

# ----
# Calculate operational emissions
number_slider_2 = Slider(1.3, range=0..10)
area = Slider(1.3, range=0..10)
list_8 = ValueList({"Conservative": "conservative", "Typical": "typical"}, selected="Conservative")
calculate_operational_emissions = BrimstoneCalculateOperationalEmissions(lca_data=get_lca_data_2.lca_data, eui=number_slider_2, area=area, mode=list_8)  # -> out, gwp_total; inputs lca_data: tree
# ---------- calculate_operational_emissions: Python ----------
"""Calculates operational emissions based on energy resource, EUI and floor area
    Inputs:
        lca_data: tree containing GWP information for the selected resource
        eui: energy use intensity of building in kWh/m2
        gfa: gross floor area of building
        mode: mode of GWP calculation ("typical" or "conservative")
        
    Output:
        gwp_total: total GWP for the selected space"""

import scriptcontext
import brimstone
reload(brimstone)
ghenv.Component.Message = brimstone.globals.version

ghenv.Component.Name = 'Brimstone - Calculate Operational Emissions'
ghenv.Component.NickName = 'Calculate Operational Emissions'

import rhinoscriptsyntax as rs
import ghpythonlib.treehelpers as th

from collections import OrderedDict

inv_unit_string = 'kWh'
gwp_unit_string = 'kg CO2 eq./kWh' # GWP

def main(lca_data, eui, area, mode):
    if not lca_data.BranchCount:
        brimstone.utils.warn(ghenv, "LCA data is missing")
        return
    if not eui:
        brimstone.utils.warn(ghenv, "EUI is missing")
        return
    if not area:
        brimstone.utils.warn(ghenv, "Area is missing")
        return
    
    lca_data = th.tree_to_list(lca_data)
    lca_data = [OrderedDict(zip(l[0], l[1])) for l in lca_data]
    gwp_total =  []
    
    for resource_lca_data in lca_data:
        try:
            gwp_total.append(calculate_gwp_total(resource_lca_data, eui, area, mode))
        except KeyError as e:
            raise Exception("GWP value could not be calculated: {error}".format(error = e))
    
    return gwp_total
    
def calculate_gwp_total(lca_data, eui, area, mode):    
    print lca_data
    inv_unit = lca_data["InventoryUnit"]
    
    if inv_unit != inv_unit_string:
        raise Exception("Wrong unit for calculation of operational energy")    
    
    gwp_unit = lca_data["GWPUnit"]
    if gwp_unit != gwp_unit_string:
        raise Exception("Wrong unit for GWP calculation")
    
    if mode == "conservative":
        gwp_a1_a3_str = "GWPA1A3Conservative"
    elif mode == "typical":
        gwp_a1_a3_str = "GWPA1A3Typical"
    else:
        raise Exception("Mode not recognised (must be conservative or typical)")
    
    gwp_impact = (
        float(lca_data[gwp_a1_a3_str])
    )
    
    gwp_total = (
        float(lca_data[gwp_a1_a3_str])
    ) * area * eui
        
    return gwp_total

if __name__ == "__main__":
    if not scriptcontext.sticky["brimstone_flying"]:
        raise Exception("The 'Brimstone - Fly' component needs to exist on the canvas")   
    gwp_total = main(lca_data, eui, area, mode)
    gwp_total = th.list_to_tree(gwp_total)
# ---------- end calculate_operational_emissions ----------

# ----
# Add LCA data to Construction
number_slider_3 = Slider(15, range=0..100)
python = GhPythonScript(lca_data=get_lca_data_3.lca_data)  # -> gwp_a1_a3, gwp_a4, density; inputs lca_data: tree
# ---------- python: Python ----------
import ghpythonlib.treehelpers as th
lca_data = th.tree_to_list(lca_data)[0]

lca_data = dict(zip(lca_data[0], lca_data[1]))
print lca_data
gwp_a1_a3 = lca_data["GWPA1A3Conservative"]
gwp_a4 = lca_data["GWPA4"]
density = lca_data["ConversionValue"]
# ---------- end python ----------
create_honeybee_model = CreateHoneybeeModel()
# Create Honeybee Material and Assign GWP Info
panel_6 = Panel(" new material")

# ----
# Extract LCA data
concat = Concatenate(FragmentA=get_lca_data.indicators, FragmentC=": ", FragmentB=get_lca_data.values)
panel_7 = Panel(concat)

pt = Point(Point(1, 1, 1))
# Connect GWP data to geometry
pt_2 = Point(Point(0, 0, 0))
list_9 = ValueList({"Conservative": "conservative", "Typical": "typical"}, selected="Conservative")
box = Box2Pt(PointA=pt_2, PointB=pt, Plane=PlaneXY(0, 0, 0))
calculate_solid_geometry = BrimstoneCalculateSolidGeometry(lca_data=get_lca_data.lca_data, geometry=box, mode=list_9)  # -> out, gwp_total; inputs lca_data: tree, geometry: GeometryBase
# ---------- calculate_solid_geometry: Python ----------
"""Extracts LCA indicators and values from a Klimatdatabas json for a specific resource
    Inputs:
        lca_data: tree containing GWP information for the selected resource
        geometry: brep geometry
        mode: mode of GWP calculation ("typical" or "conservative")
    Output:
        gwp_total: total GWP for the selected material and geometry"""

import scriptcontext
import brimstone
reload(brimstone)
ghenv.Component.Message = brimstone.globals.version

ghenv.Component.Name = 'Brimstone - Calculate Solid Geometry'
ghenv.Component.NickName = ' Calculate Solid Geometry'

import rhinoscriptsyntax as rs
import ghpythonlib.treehelpers as th

from collections import OrderedDict

mass_inv_unit_string = 'kg' # mass
density_conv_unit_string = u'kg/m\xb3' # density
gwp_unit_string = 'kg CO2 eq./kg' # GWP

def main(lca_data, geometry, mode):
    if not lca_data.BranchCount:
        brimstone.utils.warn(ghenv, "LCA data is missing")
        return
    if not geometry:
        brimstone.utils.warn(ghenv, "Geometry is missing")
        return
    lca_data = th.tree_to_list(lca_data)
    lca_data = [OrderedDict(zip(l[0], l[1])) for l in lca_data]
    gwp_total =  []
    
    for resource_lca_data in lca_data:
        try:
            gwp_total.append(calculate_gwp_total(resource_lca_data, geometry, mode))
        except KeyError as e:
            raise Exception("GWP value could not be calculated: {error}".format(error = e))
    
    
    return gwp_total
    
def calculate_gwp_total(lca_data, geometry, mode):    
    inv_unit = lca_data["InventoryUnit"]
    conv_unit = lca_data["ConversionUnit"]
    
    if conv_unit != density_conv_unit_string or inv_unit != mass_inv_unit_string:
        raise Exception("Wrong unit for conversion from volume to mass")    
    
    gwp_unit = lca_data["GWPUnit"]
    if gwp_unit != gwp_unit_string:
        raise Exception("Wrong unit for GWP calculation")
    
    vol = rs.SurfaceVolume(geometry)[0]
    conv_value = float(lca_data["ConversionValue"])
    
    if mode == "conservative":
        gwp_a1_a3_str = "GWPA1A3Conservative"
    elif mode == "typical":
        gwp_a1_a3_str = "GWPA1A3Typical"
    else:
        raise Exception("Mode not recognised (must be conservative or typical)")
    
    gwp_impact = (
        float(lca_data[gwp_a1_a3_str])
        + float(lca_data["GWPA4"]) \
        + float(lca_data["GWPA5.1"])
    )
    
    gwp_total = (
        float(lca_data[gwp_a1_a3_str])
        + float(lca_data["GWPA4"]) \
        + float(lca_data["GWPA5.1"])
    ) * vol * conv_value
        
    return gwp_total

if __name__ == "__main__":
    if not scriptcontext.sticky["brimstone_flying"]:
        raise Exception("The 'Brimstone - Fly' component needs to exist on the canvas")   
    gwp_total = main(lca_data, geometry, mode)
    gwp_total = th.list_to_tree(gwp_total)
# ---------- end calculate_solid_geometry ----------
panel_8 = Panel(calculate_solid_geometry.gwp_total)

number_slider_4 = Slider(0, range=0..1)

data = Data(get_lca_data.indicators)
data_2 = Data(get_lca_data.values)
number_slider_5 = Slider(7, range=0..10)
number_slider_6 = Slider(5, range=0..10)
number_slider_7 = Slider(8, range=0..10)
panel_9 = Panel(list_7)
item = ListItem(List=data_2, Index=number_slider_5, Wrap=True)
item_2 = ListItem(List=data, Index=number_slider_5, Wrap=True)
item_3 = ListItem(List=data_2, Index=number_slider_6, Wrap=True)
item_4 = ListItem(List=data, Index=number_slider_6, Wrap=True)
item_5 = ListItem(List=data_2, Index=number_slider_7, Wrap=True)
item_6 = ListItem(List=data, Index=number_slider_7, Wrap=True)
opaquemat = HBOpaqueMaterial(
    name=panel_6,
    thickness=Slider(0.3, range=0..1),
    conductivity=Slider(0.7, range=0..1),
    density=Slider(2165, range=0..10000),
    spec_heat=Slider(900, range=0..1000),
    roughness="Rough",
    therm_absp=Slider(0.68, range=0..1),
    sol_absp=Slider(0.75, range=0..1))  # -> mat; plug-in component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
panel_10 = Panel(item_6)
panel_11 = Panel(item_4)
panel_12 = Panel(item_2)
add_life_cycle_info = BrimstoneAddLifeCycleInfoToHoneybeeMaterial(
    hb_material=opaquemat,
    gwp_a1_a3=item_3,
    gwp_a4=item,
    gwp_a5_1=item_5,
    gwp_c1=number_slider_4,
    gwp_c2=number_slider_4,
    gwp_c3=number_slider_4)  # -> mod_material
# ---------- add_life_cycle_info: Python ----------
"""
Adds GWP info to a Honeybee Material

    Args:
        hb_material: Honeybee EnergyMaterial to be updated
        gwp_a1_a3: GWP (A1-A3) [kg CO2eq/kg]
        gwp_a4: GWP (A4) [kg CO2eq/kg]
        gwp_a5_1: GWP (A5.1) [kg CO2eq/kg]

    Returns:
        mod_material: Updated Honeybee EnergyMaterial
"""

import scriptcontext
import brimstone
ghenv.Component.Message = brimstone.globals.version
import Grasshopper

ghenv.Component.Name = 'Brimstone - Add Life Cycle Info to Honeybee Material'
ghenv.Component.NickName = 'Add Life Cycle Info'

try:  # import the core honeybee dependencies
    from honeybee_energy.material.opaque import EnergyMaterial
except ImportError as e:
    raise ImportError('\nFailed to import honeybee:\n\t{}'.format(e))

def main(hb_material):
    if not isinstance(hb_material, EnergyMaterial):
        raise Exception("Input material must be a valid Honeybee material")
    mod_material = hb_material.duplicate()
    user_data = mod_material.user_data if mod_material.user_data else {}
    
    impact_data = {
        "gwp_a1_a3": gwp_a1_a3,
        "gwp_a4": gwp_a4,
        "gwp_a5": gwp_a5_1,
        "gwp_c1": gwp_c1,
        "gwp_c2": gwp_c2,
        "gwp_c3": gwp_c3,
    }
    
    for k, v in impact_data.items():
        if v is not None:
            user_data[k] = v

    mod_material.user_data = user_data
    
    return mod_material

if __name__ == "__main__":
    try:
        flying = scriptcontext.sticky["brimstone_flying"]
    except:
        raise Exception("The 'Brimstone - Fly' component needs to exist on the canvas")
    mod_material = main(hb_material)
# ---------- end add_life_cycle_info ----------

# ----
# Create Honeybee Construction
panel_13 = Panel("Default construction")
list_10 = ValueList({"Opaque": "opaque", "Aperture": "aperture"}, selected="Aperture")
list_11 = ValueList({"Opaque": "opaque", "Aperture": "aperture"}, selected="Opaque")

entwine_3 = Entwine(Branch00=list_11, Branch01=list_10, FlattenInputs=True)
entwine_4 = Entwine(Branch00=panel_13, Branch01="Window construction", FlattenInputs=True)

klimatdatabas_materials_to_hb = BrimstoneHoneybeeConstructionFromKlimatdatabasMaterials(construction_name=entwine_4, kdb_material_names=entwine_2, thicknesses=Slider(0.2, range=0..1), mode=entwine_3)  # -> simplify(hb_materials), simplify(hb_construction); inputs kdb_material_names: list, thicknesses: list
# ---------- klimatdatabas_materials_to_hb: Python ----------
# Inspired by HB Opaque Material/HB Window Construction from Ladybug Tools 1.6.0

"""
Creates a Honeybee Construction from a list of Klimatdatabas material names

    Args:
        construction_name: Name of output construction
        kdb_material_names: list of Klimatdatabas material names
        thicknesses: thickness of each material layer in metres (if opaque construction)
        mode: If opaque or aperture construction should be generated

    Returns:
        hb_materials: list of Honeybee Materials
        hb_contruction: Honeybee Construction
"""

import scriptcontext
import os
import Grasshopper

import brimstone
from brimstone import utils
ghenv.Component.Message = brimstone.globals.version

import json

ghenv.Component.Name = 'Brimstone - Honeybee Construction from Klimatdatabas materials'
ghenv.Component.NickName = 'Klimatdatabas Materials to HB'

try:  # import the core honeybee dependencies
    from honeybee_energy.material.opaque import EnergyMaterial
    from honeybee_energy.material.glazing import EnergyWindowMaterialSimpleGlazSys
    from honeybee_energy.construction.opaque import OpaqueConstruction
    from honeybee_energy.construction.window import WindowConstruction
    from honeybee.typing import clean_ep_string
except ImportError as e:
    raise ImportError('\nFailed to import honeybee:\n\t{}'.format(e))

def main(construction_name, kdb_material_names, thicknesses, mode):
    assert mode in ["opaque", "aperture"], "Mode " + mode + " is not supported"
    if mode == "opaque":
        assert len(kdb_material_names) == len(thicknesses), "Materials and thickness list must be of the same length"
    hb_materials = []
    json_data_file = brimstone.globals.kdb_hb_json_path
    json_data_file_path = os.path.join(Grasshopper.Folders.UserObjectFolders[0], json_data_file)
    if not os.path.exists(json_data_file_path):
        raise Exception("Failed to open json file, it should reside in [UserComponents folder]/brimstone_data/")
    with open(json_data_file_path, 'r') as json_file:
        json_data = json.load(json_file)
        for (i, kdb_material_name) in enumerate(kdb_material_names):
          
            try:
                mat_data = json_data[mode][kdb_material_name]
            except:
                raise Exception("Material " + kdb_material_name + " was not found in json database")
            if not mat_data["valid"]:
                utils.warn(ghenv, "Material may be faulty as the material data for " + kdb_material_name + " is invalid")
            
            # this is a bit hacky as HB can't take commas in the name
            mat_data["identifier"] = clean_ep_string(kdb_material_name)
            
            if mode == "opaque":
                mat_data["type"] = 'EnergyMaterial'
                mat_data["thickness"] = thicknesses[i]        
                hb_material = EnergyMaterial.from_dict(mat_data)
            elif mode == "aperture":
                mat_data["type"] = 'EnergyWindowMaterialSimpleGlazSys'
                hb_material = EnergyWindowMaterialSimpleGlazSys.from_dict(mat_data)
                
            hb_material.display_name = kdb_material_name
            hb_materials.append(hb_material)
    
    con_name = clean_ep_string(construction_name)
    
    if mode == "opaque":
        hb_construction = OpaqueConstruction(con_name, hb_materials)
    elif mode == "aperture":
        hb_construction = WindowConstruction(con_name, hb_materials)
    
    return hb_materials, hb_construction

if __name__ == "__main__":
    try:
        flying = scriptcontext.sticky["brimstone_flying"]
    except:
        raise Exception("The 'Brimstone - Fly' component needs to exist on the canvas")
    print construction_name
    if not construction_name:
        
        raise Exception("Construction name is missing")
    hb_materials, hb_construction = main(construction_name, kdb_material_names, thicknesses, mode)
# ---------- end klimatdatabas_materials_to_hb ----------
bang = ExplodeTree(Data=klimatdatabas_materials_to_hb.hb_materials)  # -> Branch0, Branch1
# Create Honeybee Model
bang_2 = ExplodeTree(Data=klimatdatabas_materials_to_hb.hb_construction)  # -> Branch0, Branch1

# ----
# Modify Honeybee Construction Layer Thicknesses
add_life_cycle_info_construction = BrimstoneAddLifeCycleInfoToHoneybeeConstruction(hb_construction=bang_2.Branch1, gwp_a1_a3=python.gwp_a1_a3, gwp_a4=python.gwp_a4, density=python.density)  # -> mod_construction
# ---------- add_life_cycle_info_construction: Python ----------
"""
Adds GWP info to a Honeybee Construction

    Args:
        hb_construction: Honeybee Construction to be updated
        gwp_a1_a3: GWP (A1-A3) [kg CO2eq/kg]
        gwp_a4: GWP (A4) [kg CO2eq/kg]
        density: density [kg/m2]

    Returns:
        mod_construction: Updated Honeybee Construction
"""

import scriptcontext
import brimstone
ghenv.Component.Message = brimstone.globals.version
import Grasshopper

ghenv.Component.Name = 'Brimstone - Add Life Cycle Info to Honeybee Construction'
ghenv.Component.NickName = 'Add Life Cycle Info (Construction)'

try:  # import the core honeybee dependencies
    from honeybee_energy.construction.window import WindowConstruction
    from honeybee_energy.construction.opaque import OpaqueConstruction
except ImportError as e:
    raise ImportError('\nFailed to import honeybee:\n\t{}'.format(e))

def main(hb_construction, gwp_a1_a3, gwp_a4, density):
    if not isinstance(hb_construction, WindowConstruction)\
        and not isinstance(hb_construction, OpaqueConstruction):
        raise Exception("Currently only Window and Opaque constructions are supported")
    mod_construction = hb_construction.duplicate()
    user_data = mod_construction.user_data if mod_construction.user_data else {}
    
    if gwp_a1_a3 is not None:
        user_data["gwp_a1_a3"] = gwp_a1_a3
    if gwp_a4 is not None:
        user_data["gwp_a4"] = gwp_a4
    if density is not None:
        user_data["conv_value"] = density
    
    mod_construction.user_data = user_data

    return mod_construction

if __name__ == "__main__":
    try:
        flying = scriptcontext.sticky["brimstone_flying"]
    except:
        raise Exception("The 'Brimstone - Fly' component needs to exist on the canvas")
    mod_construction = main(hb_construction, gwp_a1_a3, gwp_a4, density)
# ---------- end add_life_cycle_info_construction ----------

cluster = Cluster(
    model=create_honeybee_model,
    materials=bang.Branch0,
    construction=bang_2.Branch0,
    window=add_life_cycle_info_construction)  # -> model_3, materials_2
calculate_honeybee_model = BrimstoneCalculateEmbodiedCarbonOfHoneybeeModel(hb_model=cluster.model_3, kdb_json_data=get_lca_data.json_data)  # -> tot_emb_carbon, elements, el_emb_carbon, elements_modules, el_emb_carbon_modules, materials, material_amounts
# ---------- calculate_honeybee_model: Python ----------
"""
Calculates embodied carbon for the elements of a Honeybee model if data is available
This component was inspired by the 'HB Color Face Attributes' component of Ladybug Tools 1.6.0

    Args:
        hb_model: Honeybee model for analysis
        kdb_json_data: Optional json data object for materials which do not include impact data

    Returns:
        tot_emb_carbon: total embodied carbon of model
        elements: element types in the model
        el_emb_carbon: embodied carbon for each element type in the model
"""

import scriptcontext
import brimstone
ghenv.Component.Message = brimstone.globals.version
import Grasshopper
import os
import csv, codecs

ghenv.Component.Name = 'Brimstone - Calculate Embodied Carbon of Honeybee Model'
ghenv.Component.NickName = 'Calculate Honeybee Model'

try:  # import the core honeybee dependencies
    from honeybee_energy.construction.windowshade import WindowConstructionShade
    from honeybee_energy.construction.air import AirBoundaryConstruction
    from honeybee_energy.material.opaque import EnergyMaterialNoMass
    from honeybee.model import Model
    from honeybee.properties import FaceProperties
    from honeybee.typing import clean_ep_string
except ImportError as e:
    raise ImportError('\nFailed to import honeybee:\n\t{}'.format(e))
    

# todo: magic string here - not good!
gwp_data_string = "Global Warming potential"
gwp_data_points = {
    "gwp_a1_a3": "A1-A3 Conservative",
    "gwp_a4": "A4",
    "gwp_a5_1": "A5.1",
}

# Hack to fix default materials for ACE405 course
# From klimatdatabas 02.05.000
default_layers = {
    "Expanded polystyrene": {
        "gwp_a1_a3": 4,
        "gwp_a4": 0.0345,
        "gwp_a5_1": 0.282,
    },
    "Mineral wool": {
        "gwp_a1_a3": 1.6,
        "gwp_a4": 0.0345,
        "gwp_a5_1": 0.114,
    },
    "Timber": {
        "gwp_a1_a3": 0.08,
        "gwp_a4": 0.0158,
        "gwp_a5_1": 0.00958,
    },
    "Solid brick": {
        "gwp_a1_a3": 0.314,
        "gwp_a4": 0.0495,
        "gwp_a5_1": 0.0182,
    },
    "Gypsum plasterboard": {
        "gwp_a1_a3": 0.284,
        "gwp_a4": 0.0232,
        "gwp_a5_1": 0.0368,
    },
    "Medium density concrete": {
        "gwp_a1_a3": 0.0913,
        "gwp_a4": 0.0039,
        "gwp_a5_1": 0.00285,
    },
    "Ceramic and porcelain": {
        "gwp_a1_a3": 2.5,
        "gwp_a4": 0,
        "gwp_a5_1": 0,
    },
    "Steel": {
        "gwp_a1_a3": 3.15,
        "gwp_a4": 0.0795,
        "gwp_a5_1": 0.161,
    },
    "Crystalline stone": {
        "gwp_a1_a3": 0.5,
        "gwp_a4": 0.0,
        "gwp_a5_1": 0.0,
    },
    "Soil/sand/gravel": {
        "gwp_a1_a3": 0.02,
        "gwp_a4": 0,
        "gwp_a5_1": 0,
    },
}

# hack to fix ACE405 issues
# used if single layer aperture has no matching material
# source: klimatdatabas 02.005.000 aluminum window
# https://klimatdatabasen.boverket.se/detaljer/3/6000000225
default_aperture_density = 39.2# [kg/m2]
default_aperture_impact = { # value is kg CO2eq/m2
    "gwp_a1_a3": 3.83 * default_aperture_density,
    "gwp_a4": 0.0626 * default_aperture_density,
    "gwp_a5_1": 0.0 * default_aperture_density,
}

def main(hb_model):
    tot_emb_carbon = 0
    elements = []
    el_emb_carbon = []
    elements_modules = []
    el_emb_carbon_modules = []
    if not isinstance(hb_model, Model):
        raise Exception("hb_model input must be a valid honeybee model")
    faces = []
    apertures = []
    model_mats = []
    face_types = {
    }
    
    for face_type in [
        "Wall",
        "RoofCeiling",
        "Floor",
        "Aperture",
    ]: 
        face_types[face_type] = { "impact": {} }
    
    energy_properties = hb_model.properties.energy
    
    for material in energy_properties.materials:
        model_mats.append(material)
    for room in hb_model.rooms:
        faces.extend(room.faces)
        faces.extend(room.shades)
    faces.extend(hb_model.orphaned_faces)
    faces.extend(hb_model.orphaned_apertures)
    faces.extend(hb_model.orphaned_doors)
    faces.extend(hb_model.orphaned_shades)
    
    for face_obj in faces:
        
        if isinstance(face_obj.properties, FaceProperties):
            if isinstance(face_obj.properties.energy.construction, AirBoundaryConstruction):
                continue # skip if airboundary
                
            face_area = face_obj.area - face_obj.aperture_area
            face_type = face_obj.type
            
            face_impact = {}
            for lyr in face_obj.properties.energy.construction.layers:
                #print face_type, lyr, face_area
                face_impact_per_module = get_face_impact(model_mats, lyr, face_area)
                for key in face_impact_per_module:
                    if key in face_impact:
                        face_impact[key] += face_impact_per_module[key]
                    else:
                         face_impact[key] = face_impact_per_module[key]
                """
                if lyr not in model_mats:
                    model_mats[lyr] = { area: face_area }
                else:
                    model_mats[lyr].area = model_mats[lyr].area + face_area
                """
                       
            if str(face_type) not in face_types:
                face_types[str(face_type)] = { "impact": face_impact }
            else:
                for key in face_impact:
                    if key in face_types[str(face_type)]["impact"]:
                        face_types[str(face_type)]["impact"][key] += face_impact[key]
                    else:
                        face_types[str(face_type)]["impact"][key] = face_impact[key]
                
            for aperture in face_obj.apertures:
                aperture_impact = get_aperture_impact(aperture)
                if "Aperture" not in face_types:
                    face_types["Aperture"] = { "impact": aperture_impact }
                else:
                    for key in aperture_impact:
                        if key in face_types["Aperture"]["impact"]:
                            face_types["Aperture"]["impact"][key] += aperture_impact[key]
                        else:
                            face_types["Aperture"]["impact"][key] = aperture_impact[key]
    for face_type in face_types.items():
        face_impact = sum(face_type[1]["impact"].values())
        tot_emb_carbon += face_impact
        elements.append(face_type[0])
        el_emb_carbon.append(face_impact)
        
        for key, value in face_type[1]["impact"].items():
            elements_modules.append(str(face_type[0]) + " " + key)
            el_emb_carbon_modules.append(value)
    return tot_emb_carbon, elements, el_emb_carbon, elements_modules, el_emb_carbon_modules

def get_face_impact(materials, layer_name, face_area):
    for material in materials:
        if material.identifier == layer_name:
            if type(material) == EnergyMaterialNoMass:
                brimstone.utils.warn(ghenv, "The calculation may be faulty as material " + layer_name + " is modelled as EnergyMaterialNoMass.")
                return {}
            abs_impact = {}
            gwp_data_keys = gwp_data_points.keys()
            
            if material.user_data and all(key in material.user_data.keys() for key in gwp_data_keys):
                for key, value in gwp_data_points.items():
                    abs_impact[value] = material.density*material.user_data[key]
            elif material.user_data and layer_name in default_layers:
                for key in gwp_data_keys:
                    material.user_data[key] = default_layers[layer_name][key]
            else:
                abs_impact = get_face_impact_from_material_name(material.identifier, material.density)
            impact = { key: material.thickness*abs_impact[key]*face_area for key in abs_impact }
            return impact
    brimstone.utils.warn(ghenv, "The calculation may be faulty as material " + layer_name + " was not found among the energy materials in the model.")
    return {}

# Gets material impact data from a honeybee material by referencing names in .csv file
def get_face_impact_from_material_name(material_name, density):
    csv_data_file = brimstone.globals.hb_kdb_csv_path
    csv_data_file_path = os.path.join(Grasshopper.Folders.UserObjectFolders[0], csv_data_file)
    if not os.path.exists(csv_data_file_path):
        raise Exception("Failed to open csv file, it should reside in [UserComponents folder]/brimstone_data/")
    kdb_name = check_name_in_kdb(material_name)
    if not kdb_name:
        with open(csv_data_file_path, 'r') as csv_file:
            file_reader = csv.DictReader(csv_file, delimiter=",")
            for row in file_reader:
                if row["HB Name"] == material_name:
                    kdb_name = clean_ep_string(row["Klimatdatabas name"])
                    if not kdb_name or kdb_name == "missing":
                        brimstone.utils.warn(ghenv, "The calculation may be faulty as impact data is missing for some of the materials in the model: " + material_name)
                        return {}
                    break
    if not kdb_name:
        brimstone.utils.warn(ghenv, "The calculation may be faulty as material " + material_name + " could not be matched to any material in the brimstone material database.")
        return {}
    
    return get_impact_from_json_data(kdb_name, density)

def check_name_in_kdb(material_name):
    if not kdb_json_data:
        brimstone.utils.warn(ghenv, "The calculation may be faulty as kdb_json_data is missing")
    else: 
        for resource in kdb_json_data["Resources"]:
            if clean_ep_string(resource["Name"]) == material_name:
                return material_name
    return ""
    
# TODO: currently only works for KDB windows
def get_aperture_impact(aperture):
    c = aperture.properties.energy.construction
    c = c.window_construction if type(c) == WindowConstructionShade else c
    if c.user_data and "conv_value" in c.user_data:
        impact = {}
        for key, value in gwp_data_points.items():
            if key in c.user_data:
                impact[value] = float(c.user_data[key]) * c.user_data["conv_value"] * aperture.area
        return impact
    if not len(c.layers) == 1:
        brimstone.utils.warn(ghenv, "The calculation may be faulty as only one layer window constructions can be calculated.")
        return {}
    
    window_material = c.layers[0]
    abs_impact = get_impact_from_json_data(window_material)
    
    # hack to fix ACE405 calculations
    if not len(abs_impact.keys()):
        abs_impact = default_aperture_impact
    
    impact = { key: abs_impact[key]*aperture.area for key in abs_impact }
    return impact

# density parameter is used as fallback if KDB data does not have density
def get_impact_from_json_data(kdb_name, density = 0):
    if not kdb_json_data:
        brimstone.utils.warn(ghenv, "The calculation may be faulty as kdb_json_data is missing")
        return {}
    for resource in kdb_json_data["Resources"]:
        if clean_ep_string(resource["Name"]) == kdb_name:
            if "Conversions" not in resource:
                brimstone.utils.warn(ghenv, "The calculation may be faulty as material " + kdb_name + " has no conversion value in kdb_json_data. Using HB material density")
                conv = density
            else:
                conv = resource["Conversions"][0]["Value"]
            
            for data_item in resource["DataItems"]:
                if data_item["PropertyName"] == gwp_data_string:
                    abs_impact = {}
                    for data_pt in gwp_data_points.values():
                        for data_val_item in data_item["DataValueItems"]:
                            if data_val_item["DataModuleCode"] == data_pt:
                                abs_impact[data_pt] = data_val_item["Value"]*conv
                    return abs_impact
            brimstone.utils.warn(ghenv, "The calculation may be faulty as material " + kdb_name + " has no GWP data in kdb_json_data")
            return {}
    brimstone.utils.warn(ghenv, "The calculation may be faulty as material " + kdb_name + " was not found in kdb_json_data")
    return {}

if __name__ == "__main__":
    try:
        flying = scriptcontext.sticky["brimstone_flying"]
    except:
        raise Exception("The 'Brimstone - Fly' component needs to exist on the canvas")
    tot_emb_carbon, elements, el_emb_carbon, elements_modules, el_emb_carbon_modules = main(hb_model)
# ---------- end calculate_honeybee_model ----------
panel_14 = Panel(calculate_honeybee_model.elements)
panel_15 = Panel(calculate_honeybee_model.el_emb_carbon)

number_slider_8 = Slider(0.159, range=0..1)
number_slider_9 = Slider(0.159, range=0..1)
number_slider_10 = Slider(0.159, range=0..1)
merge_3 = Merge(Data1=Slider(0.31, range=0..1))
modify_layer_thicknesses = BrimstoneModifyThicknessesOfHoneybeeMaterials(hb_materials=cluster.materials_2, thicknesses=merge_3)  # -> mod_materials; inputs hb_materials: list, thicknesses: list
# ---------- modify_layer_thicknesses: Python ----------
"""
Updates thicknesses of a list of HB materials

    Args:
        hb_materials: List of Honeybee materials which should get new thickness
        thicknesses: List of new material thicknesses

    Returns:
        mod_materials: Modified Honeybee materials
"""

import scriptcontext
import brimstone
ghenv.Component.Message = brimstone.globals.version

ghenv.Component.Name = 'Brimstone - Modify thicknesses of Honeybee materials'
ghenv.Component.NickName = 'Modify layer thicknesses'

try:  # import the core honeybee dependencies
    from honeybee_energy.material.opaque import EnergyMaterial
    from honeybee_energy.material.opaque import EnergyMaterialNoMass
except ImportError as e:
    raise ImportError('\nFailed to import honeybee:\n\t{}'.format(e))

def main(hb_materials, thicknesses):
    mod_materials = []
    assert len(hb_materials) == len(thicknesses), "Materials and thickness list must be of the same length"
    for (i, material) in enumerate(hb_materials):
        if not isinstance(material, EnergyMaterial):
            if isinstance(material, EnergyMaterialNoMass):
                mod_materials.append(material)
            else:
                raise Exception("All materials must be valid Honeybee Energy Materials or Energy Materials (No Mass)")
        else: # if material is EnergyMaterial
            mod_material = material.duplicate()
            mod_material.thickness = thicknesses[i]
            mod_materials.append(mod_material)
    return mod_materials

if __name__ == "__main__":
    try:
        flying = scriptcontext.sticky["brimstone_flying"]
    except:
        raise Exception("The 'Brimstone - Fly' component needs to exist on the canvas")
    mod_materials = main(hb_materials, thicknesses)
# ---------- end modify_layer_thicknesses ----------
opaqueconstr = HBOpaqueConstruction(materials=modify_layer_thicknesses)  # -> constr; plug-in component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

vizbybc = HBVisualizeByBC(hb_objs=cluster.model_3)  # -> outdoors, surface, ground, adiabatic, other, wire_frame; plug-in component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
# Calculate Honeybee Model Embodied GWP
vizquick = HBVisualizeQuick(hb_objs=flatten(cluster.model_3))  # -> geo; plug-in component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
panel_16 = Panel(calculate_honeybee_model.elements_modules)
panel_17 = Panel(calculate_honeybee_model.materials)
panel_18 = Panel(calculate_honeybee_model.material_amounts)
panel_19 = Panel(calculate_honeybee_model.el_emb_carbon_modules)

# ==== cluster Cluster
bldgvintages = HBBuildingVintages({"ASHRAE 90.1 2019  |  IECC 2021": "2019", "ASHRAE 90.1 2016  |  IECC 2018": "2016", "ASHRAE 90.1 2013  |  IECC 2015": "2013", "ASHRAE 90.1 2010  |  IECC 2012": "2010", "ASHRAE 90.1 2007  |  IECC 2009": "2007", "ASHRAE 90.1 2004  |  IECC 2006": "2004", "1980-2004 (CBECS)": "1980_2004", "Pre-1980 (CBECS)": "pre_1980"}, selected="ASHRAE 90.1 2019  |  IECC 2021")
constructiontypes = HBConstructionTypes({"SteelFramed", "WoodFramed", "Mass", "Metal Building"}, selected="WoodFramed")
climatezones = HBClimateZones({"1 - Very Hot": "1", "2 - Hot": "2", "3 - Warm": "3", "4 - Mixed": "4", "5 - Cool": "5", "6 - Cold": "6", "7 - Very Cold": "7", "8 - Subarctic": "8"}, selected="6 - Cold")
construction = ClusterInput()
window = ClusterInput()
materials = ClusterInput()
model = ClusterInput()
opaqueconstr = HBOpaqueConstruction(materials=materials)  # -> constr; plug-in component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
constrsetclimate = HBConstructionSetByClimate(climate_zone=climatezones, vintage=bldgvintages, constr_type=constructiontypes)  # -> constr_set; plug-in component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
construction_2 = Data(construction)
groundsubset = HBGroundConstructionSubset(ground_floor=construction_2)  # -> ground_set; plug-in component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
subfacesubset = HBSubfaceSubset(window=window)  # -> subface_set; plug-in component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
exteriorsubset = HBExteriorConstructionSubset(exterior_wall=opaqueconstr, exterior_roof=construction_2, exposed_floor=opaqueconstr)  # -> exterior_set; plug-in component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
panel = Panel(constrsetclimate)
constructionset = HBConstructionSet(base_constr_set=panel, exterior_subset=exteriorsubset, ground_subset=groundsubset, subface_subset=subfacesubset)  # -> constr_set; plug-in component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
deconstructmodel = HBDeconstructModel(model=model)  # -> rooms, faces, apertures, doors, shades; plug-in component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
applyconstrset = HBApplyConstructionSet(rooms=deconstructmodel.rooms, constr_set=constructionset)  # -> rooms; plug-in component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
decnstrconstrset = HBDeconstructConstructionSet(constr_set=constructionset)  # -> exterior_wall, exterior_roof, exposed_floor, ground_wall, ground_roof, ground_floor, window, skylight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; plug-in component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
model_2 = HBModel(rooms=flatten(applyconstrset))  # -> report, model; plug-in component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
decnstrconstr = HBDeconstructConstruction(constr=decnstrconstrset.exterior_wall)  # -> materials, layers, r_val_si, r_val_ip, u_fac_si, u_fac_ip, shgc, t_sol, t_vis; plug-in component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
model_3 = ClusterOutput(model_2.model)
materials_2 = ClusterOutput(decnstrconstr.materials)

# ==== cluster CreateHoneybeeModel
pt = ConstructPoint(XCoordinate=Slider(5, range=0..10), YCoordinate=Slider(5, range=0..10), ZCoordinate=Slider(5, range=0..10))
pt_2 = ConstructPoint(XCoordinate=Slider(0, range=0..10), YCoordinate=Slider(0, range=0..10), ZCoordinate=Slider(0, range=0..10))
box = Box2Pt(PointA=pt_2, PointB=pt, Plane=PlaneXY(0, 0, 0))
roomsolid = HBRoomFromSolid(geo=flatten(box), conditioned=True)  # -> report, rooms; plug-in component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

# ---- group: Windows facade ratio
number_slider = Slider(0.44, range=0..1)
facparam = HBFacadeParameters(north=Slider(0.8, range=0..1), east=Slider(0.2, range=0..1), south=Slider(0.5, range=0..1), west=Slider(0.2, range=0..1))  # -> fac_par; plug-in component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
aperturesbyratio = HBAperturesByRatio(
    hb_objs=flatten(roomsolid.rooms),
    ratio=facparam,
    subdivide=Toggle(False),
    win_height=Slider(1.6, range=0.1..2.5),
    sill_height=Slider(0.7, range=0.1..2.5))  # -> report, hb_objs; plug-in component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

# ----
model = HBModel(rooms=flatten(aperturesbyratio.hb_objs))  # -> report, model; plug-in component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
vizbytype = HBVisualizeByType(hb_objs=aperturesbyratio.hb_objs)  # -> walls, interior_walls, roofs, ceilings, exterior_floors, interior_floors, air_walls, apertures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; plug-in component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
model_2 = ClusterOutput(model.model)
