# Grasshopper definition brimstone_0.1.1.gh (Grasshopper 1.0.7)
# plug-ins: Human

# ----
# Get Klimatdatabas data
panel = Panel("./database.json")
list = ValueList({"File": "file", "API": "api"}, selected="API")
get_categories = Brimstone1GetCategories(mode=list, json_path=panel)  # -> out, json_data, categories
# ---------- get_categories: Python ----------
"""Gets Klimatdatabas from the Boverket API or a file, extracts json data, and resource category names
    Inputs:
        mode: api or file mode
        json_path: path to json file if file mode
    Output:
        json_data: json file as dictionary
        categories: Categories present in the database"""

import scriptcontext

scriptcontext.sticky["brimstone_version"] = '0.1.1'
ghenv.Component.Message = scriptcontext.sticky["brimstone_version"]

import json

from System.Net import HttpWebRequest
from System.IO import StreamReader
from System.Text import Encoding

version = "02.04.000"
lng = "en"
format = "json"

url = "https://api.boverket.se/klimatdatabas/get-all-resources/{version}/{language}/{format}".format(
    version=version, language=lng, format=format)

def main(mode, json_path):    
    if mode == "file":
        json_data = get_json_data_from_file(json_path)
    elif mode == "api":
        json_data = get_json_data_from_api()
    else:
        raise Exception("Mode {mode} not supported".format(mode = mode))
    
    categories = get_categories(json_data)
    json_data = [json_data] # need to put it in an array so GH understands it as a dictionary
    
    return categories, json_data


def get_json_data_from_file(json_path):
    f = open(json_path)
    json_data = json.load(f)
    return json_data
    
def get_json_data_from_api():
    request = HttpWebRequest()
    request = HttpWebRequest.Create(url)
    
    request.Method = "GET"
    request.Timeout = 5000
    #request.ContentType = "application/json"
    response = request.GetResponse()
    
    stream_reader = StreamReader(response.GetResponseStream())
    json_data = json.loads(stream_reader.ReadToEnd())
    return json_data
    
def get_categories(json_data):
    categories = []
    try:
        for metaCategory in json_data['Categories']:
            for cat in metaCategory["Children"]:
                categories.append(cat["Title"])
    except KeyError:
        raise Exception("Format of JSON data is not supported.")
    return categories

if __name__ == "__main__":
    categories, json_data = main(mode, json_path)
# ---------- end get_categories ----------

# ----
# Select category
list_2 = ItemSelector(
    get_categories.categories,
    {"Building boards", "Insulation", "Solid woods", "Concrete", "Blocks and tiles", "Mineral materials", "Windows, doors and glass", "Waterproofing", "Paints and sealants", "Steel and other metals", "Energy and fuel"}, selected="Energy and fuel")
get_resources = Brimstone2GetResources(json_data=get_categories.json_data, category=list_2)  # -> out, json_data, resources
# ---------- get_resources: Python ----------
"""Extracts resource names from a Klimatdatabas json object
    Inputs:
        json_data: dictionary with json data
        category: readable name of category to extract resources from
    Output:
        resources: List of resources in category"""

import scriptcontext

ghenv.Component.Message = scriptcontext.sticky["brimstone_version"]

def main(json_data, category):
    resources = get_resources(json_data, category)
    return resources
    
def get_resources(json_data, category):
    pred = lambda v: v["Text"] == category
    resources = []
    for resource in json_data["Resources"]:
        #print resource["Categories"]
        if len(filter(pred, resource["Categories"])) > 0:
            resources.append(resource["Name"])
    return resources

if __name__ == "__main__":
    resources = main(json_data, category)
    json_data = [json_data]
# ---------- end get_resources ----------

# ----
# Select resource(s)
list_3 = ItemSelector(
    get_resources.resources,
    {"Electricity, Swedish mix", "Diesel, reduction obligation  (2021)": "Diesel, reduction obligation (2021)", "Diesel, fossil", "Petrol, reduction obligation  (2021)": "Petrol, reduction obligation (2021)", "Petrol, 100% fossil", "District heating, Swedish average", "HVO100", "Gasol", "Wood pellets", "E85 ethanol", "Biogas", "Fuel oil 1", "Fuel oil 2-5", "FAME100", "ED95"}, selected="Electricity, Swedish mix")
list_4 = ItemSelector(
    get_resources.resources,
    {"Electricity, Swedish mix", "Diesel, reduction obligation  (2021)": "Diesel, reduction obligation (2021)", "Diesel, fossil", "Petrol, reduction obligation  (2021)": "Petrol, reduction obligation (2021)", "Petrol, 100% fossil", "District heating, Swedish average", "HVO100", "Gasol", "Wood pellets", "E85 ethanol", "Biogas", "Fuel oil 1", "Fuel oil 2-5", "FAME100", "ED95"}, selected="Diesel, fossil")
panel_2 = Panel("""RefServiceLifeNormal
WasteFactor""")
get_lca_data = Brimstone3GetLCAData(json_data=get_resources.json_data, resources=[list_3, list_4], addtl_indicators=panel_2)  # -> out, json_data, lca_data, indicators, values; inputs resources: list, addtl_indicators: list
#   port json_data: List of resources in category
# ---------- get_lca_data: Python ----------
"""Extracts LCA indicators and values from a Klimatdatabas json for a specific resource
    Inputs:
        json_data: dictionary with json data
        resources: list of readable names of resources
        addtl_indicators: list of additional keys to retrieve from resource
    Output:
        lca_data: list of dictionaries with LCA data for each resource
        indicators: list of indicators
        values: list of indicator values"""

import scriptcontext

import ghpythonlib.treehelpers as th

from collections import OrderedDict

ghenv.Component.Message = scriptcontext.sticky["brimstone_version"]

import copy

# todo: magic string here - not good!
gwp_data_string = "Global Warming potential"

# keys: names in output dict, values: DataModuleCode in json db
gwp_data_entries = {
    "GWPA1A3Conservative": "A1-A3 Conservative",
    "GWPA1A3Typical": "A1-A3 Typical",
    "GWPA4": "A4",
    "GWPA5.1": "A5.1",
}

def main(json_data, resource, addtl_indicators):
    lca_data, indicators, values = [], [], []

    for i, resource in enumerate(resources):
        lca_data.append(get_lca_data(json_data, resource, addtl_indicators))
        resource_indicators, resource_values = get_indicator_values(lca_data[i], addtl_indicators)
        indicators.append(resource_indicators)
        values.append(resource_values)
    return lca_data, indicators, values
    
def get_lca_data(json_data, resource_name, addtl_indicators):
    resource_data = copy.deepcopy(
        find_obj_in_array(
            json_data["Resources"],
            "Name",
            resource_name
        )
    )
    
    if not resource_data:
        raise Exception(
            "Resource with name {resource_name} was not found in database."
            .format(resource_name = resource_name)
       )
    try:
        lca_data = extract_lca_data(resource_data, addtl_indicators)
    except KeyError:
        raise Exception("Format of JSON data is not supported.")
    return lca_data

def extract_lca_data(resource_data, addtl_indicators):
    lca_data = OrderedDict()
    resource_name = resource_data["Name"]
    
    lca_data["Name"] = resource_name
    
    if "Conversions" in resource_data:
        # can a resource have multiple conversions?
        lca_data["ConversionUnit"] = resource_data["Conversions"][0]["Unit"]
        lca_data["ConversionValue"] = resource_data["Conversions"][0]["Value"]
    
    if "InventoryUnit" in resource_data:
        lca_data["InventoryUnit"] = resource_data["InventoryUnit"]
    
    for data_prop in resource_data["DataItems"]:
        if data_prop["PropertyName"] == gwp_data_string:
            gwp_data = copy.deepcopy(data_prop)
            break
            
    if not gwp_data:
        raise Exception("GWP data not found for {resource_name}"
            .format(resource_name = resource_name))
    
    lca_data["GWPUnit"] = gwp_data["PropertyUnitCode"]
    for key in gwp_data_entries:
        value = find_obj_in_array(
            gwp_data["DataValueItems"],
            "DataModuleCode",
            gwp_data_entries[key]
        )
        if value is not None:
            lca_data[key] = value["Value"]
            
    for addtl_indicator in addtl_indicators:
        if addtl_indicator in resource_data:
            lca_data[addtl_indicator] = resource_data[addtl_indicator]
    
    return lca_data

def find_obj_in_array(array, key, value):
    return next((x for x in array if x[key] == value), None)

def get_indicator_values(lca_data, addtl_indicators):
    indicator_dict = OrderedDict([
        ("Name", "Name"),
        ("InventoryUnit", "Inventory unit"),
        ("ConversionUnit", "Conversion unit"),
        ("ConversionValue", "Conversion value"),
        ("GWPUnit", "GWP unit"),
        ("GWPA1A3Conservative", "GWP (A1-A3 Conservative)"),
        ("GWPA1A3Typical", "GWP (A1-A3 Typical)"),
        ("GWPA4", "GWP (A4)"),
        ("GWPA5.1", "GWP (A5.1)"),
    ])
    
    for addtl_indicator in addtl_indicators:
        indicator_dict[addtl_indicator] = addtl_indicator
    
    print indicator_dict
    
    indicators, values = [], []
    
    for key, indicator_name in indicator_dict.items():
        print key
        indicator_value = lca_data[key] if key in lca_data else None
        if indicator_value:
            indicators.append(indicator_name)
            values.append(indicator_value)
    
    return indicators, values

if __name__ == "__main__":
    lca_data, indicators, values = main(json_data, resources, addtl_indicators)
    lca_data = [lca_data]
    indicators = th.list_to_tree(indicators)
    values = th.list_to_tree(values)
    json_data = [json_data]
# ---------- end get_lca_data ----------

# ----
# Extract LCA data
concat = Concatenate(FragmentA=get_lca_data.indicators, FragmentC=": ", FragmentB=get_lca_data.values)
panel_3 = Panel(concat)
