# Grasshopper definition brimstone_0.1.4a_jk.gh (Grasshopper 1.0.7)

data = Data(Tree({0;0;0}: ["Name", "ConversionUnit", "ConversionValue", "InventoryUnit", "GWPUnit", "GWPA1A3Conservative", "GWPA5.1", "GWPA1A3Typical", "GWPA4", "RefServiceLifeNormal", "WasteFactor", "TechnologyDescriptionAndIncludedProcesses", "ResourceId"], {0;0;1}: ["Particle board", "kg/m³", 700, "kg", "kg CO2 eq./kg", 0.488, 0.0537, 0.39, 0.0495, ">50 years", 1.1, "Chipboards are made of wood chips and resin pressed together. The amount of glue is less than 10 %. By-products from the manufaturing of sawn timber are utilised in the production of chipboards. Densities vary between 650 and 750 kg/m³.", "Grasshopper.Kernel.Types.GH_ObjectWrapper"]))
panel = Panel(data)

pt = Point(Point(1, 1, 1))
# Connect GWP data to geometry
pt_2 = Point(Point(0, 0, 0))
list = ValueList({"Conservative": "conservative", "Typical": "typical"}, selected="Conservative")
box = Box2Pt(PointA=pt_2, PointB=pt, Plane=PlaneXY(0, 0, 0))
calculate_solid_geometry = Brimstone4CalculateSolidGeometry(lca_data=panel, geometry=box, mode=list)  # -> out, gwp_total; inputs lca_data: tree, geometry: GeometryBase
# ---------- calculate_solid_geometry: Python ----------
"""Extracts LCA indicators and values from a Klimatdatabas json for a specific resource
    Inputs:
        lca_data: 
        geometry: brep geometry
        addtl_indicators: list of additional keys to retrieve from resource
    Output:
        lca_data: list of dictionaries with LCA data for each resource
        indicators: list of indicators
        values: list of indicator values"""

import scriptcontext
ghenv.Component.Message = scriptcontext.sticky["brimstone_version"]
from Grasshopper.Kernel import GH_RuntimeMessageLevel as Message

import rhinoscriptsyntax as rs
import ghpythonlib.treehelpers as th

from collections import OrderedDict

mass_inv_unit_string = 'kg' # mass
density_conv_unit_string = u'kg/m\xb3' # density
gwp_unit_string = 'kg CO2 eq./kg' # GWP

def main(lca_data, geometry, mode):
    if not lca_data.BranchCount:
        ghenv.Component.AddRuntimeMessage(Message.Warning, "LCA data is missing")
        return
    if not geometry:
        ghenv.Component.AddRuntimeMessage(Message.Warning, "Geometry is missing")
        return
    lca_data = th.tree_to_list(lca_data)
    lca_data = [OrderedDict(zip(l[0], l[1])) for l in lca_data]
    gwp_total =  []
    
    for resource_lca_data in lca_data:
        try:
            gwp_total.append(calculate_gwp_total(resource_lca_data, geometry, mode))
        except KeyError as e:
            raise Exception("GWP value could not be calculated: {error}".format(error = e))
    
    
    return gwp_total
    
def calculate_gwp_total(lca_data, geometry, mode):    
    inv_unit = lca_data["InventoryUnit"]
    conv_unit = lca_data["ConversionUnit"]
    
    if conv_unit != density_conv_unit_string or inv_unit != mass_inv_unit_string:
        raise Exception("Wrong unit for conversion from volume to mass")    
    
    gwp_unit = lca_data["GWPUnit"]
    if gwp_unit != gwp_unit_string:
        raise Exception("Wrong unit for GWP calculation")
    
    vol = rs.SurfaceVolume(geometry)[0]
    conv_value = float(lca_data["ConversionValue"])
    
    if mode == "conservative":
        gwp_a1_a3_str = "GWPA1A3Conservative"
    elif mode == "typical":
        gwp_a1_a3_str = "GWPA1A3Typical"
    else:
        raise Exception("Mode not recognised (must be conservative or typical)")
    
    gwp_impact = (
        float(lca_data[gwp_a1_a3_str])
        + float(lca_data["GWPA4"]) \
        + float(lca_data["GWPA5.1"])
    )
    
    print type(vol)
    gwp_total = gwp_impact * vol * conv_value
        
    return gwp_total

if __name__ == "__main__":
    if not scriptcontext.sticky["brimstone_flying"]:
        raise Exception("The 'Brimstone - Fly' component needs to exist on the canvas")   
    gwp_total = main(lca_data, geometry, mode)
    gwp_total = th.list_to_tree(gwp_total)
# ---------- end calculate_solid_geometry ----------
panel_2 = Panel(calculate_solid_geometry.gwp_total)
